# Grasshopper definition 1.01.gh (Grasshopper 1.0.8)
# plug-ins: LunchBox

number_slider = Slider(10, range=0..10)
number_slider_2 = Slider(20, range=0..100)
neg = Negative(Value=number_slider)
neg_2 = Negative(Value=number_slider_2)
dom = ConstructDomain(DomainStart=neg, DomainEnd=number_slider)
dom_2 = ConstructDomain(DomainStart=neg_2, DomainEnd=number_slider_2)
rectangle = Rectangle(Plane=PlaneXY(0, 0, 0), XSize=dom, YSize=dom_2, Radius=0)  # -> Rectangle, Length
md_slider = MDSlider(
    SliderMode=0,
    slider_value=Point(0.5929312357, 0.5159108232, 0.5),
    x_domain=Domain(0, 1),
    y_domain=Domain(0, 1),
    z_domain=Domain(0, 1))
srf = Surface(rectangle.Rectangle)
pt = Point(<point referenced from the Rhino model>)
pt_2 = Point(<point referenced from the Rhino model>)
grid = GridStructure(Surface=srf, UDivisions=10, VDivisions=10)  # -> StructureLines, StructureNodes
tag = TextTag3D(Location=pt, Text="A", Size=1, Justification=7)
tag_2 = TextTag3D(Location=pt_2, Text="B", Size=1, Justification=7)
subtraction = Subtraction(A=pt_2, B=pt)
evalsrf = EvaluateSurface(Surface=reparameterize(srf), Point=md_slider)  # -> Point, Normal, UDirection, VDirection, Frame
pt_3 = Point(evalsrf.Point)
vec = Vector(subtraction)
number_slider_3 = Slider(0.1, range=0..1)
pt_4 = Point(grid.StructureNodes)
panel = Panel(subtraction)
number_slider_4 = Slider(0.44, range=0..1)
vdis = VectorDisplay(Anchor=pt, Vector=vec)
c_script = CSharpScript(pts=pt_4, attr_pt=pt_3, power=number_slider_3, max_dist_pct=number_slider_4)  # -> out, a, b, c; inputs pts: list of Point3d, attr_pt: Point3d, power: Double, max_dist_pct: Double
# ---------- c_script: C# ----------
// Grasshopper Script Instance
#region Usings
using System;
using System.Linq;
using System.Collections;
using System.Collections.Generic;
using System.Drawing;

using Rhino;
using Rhino.Geometry;

using Grasshopper;
using Grasshopper.Kernel;
using Grasshopper.Kernel.Data;
using Grasshopper.Kernel.Types;
#endregion

public class Script_Instance : GH_ScriptInstance
{
    #region Notes
    /* 
      Members:
        RhinoDoc RhinoDocument
        GH_Document GrasshopperDocument
        IGH_Component Component
        int Iteration

      Methods (Virtual & overridable):
        Print(string text)
        Print(string format, params object[] args)
        Reflect(object obj)
        Reflect(object obj, string method_name)
    */
    #endregion

    private void RunScript(
		List<Point3d> pts,
		Point3d attr_pt,
		double power,
		double max_dist_pct,
		ref object a,
		ref object b,
		ref object c)
    {
        // Write your logic here
        //Attractor script

        List<Point3d> new_pts = new List<Point3d>();
        List<double> distances = new List<double>();
        List<Vector3d> vectors = new List<Vector3d>();

        foreach(Point3d gridpoint in pts)
        {
            Vector3d vector = attr_pt - gridpoint;
            vectors.Add(vector);

            double distance = vector.Length;
            distances.Add(distance);

            double maxDistance = distance * max_dist_pct;

            double actualDistance = Math.Pow(distance, power);

            double dist = Math.Min(maxDistance, actualDistance);

            vector.Unitize();

            Point3d pt = gridpoint + (vector*dist);




            new_pts.Add(pt);

        }

        a = new_pts;
        b = distances;
        c = vectors;
    }
}
# ---------- end c_script ----------
vec_2 = Vector(c_script.c)
vdis_2 = VectorDisplay(Anchor=pt_3, Vector=vec_2)

# ----
# ELLIPSE
number_slider_5 = Slider(16, range=0..30)
c_script_2 = CSharpScript(radius1=number_slider_5, radius2=Slider(16, range=0..30), count=Slider(31, range=0..100))  # -> out, a; inputs radius1: Double, radius2: Double, count: Int32
# ---------- c_script_2: C# ----------
// Grasshopper Script Instance
#region Usings
using System;
using System.Linq;
using System.Collections;
using System.Collections.Generic;
using System.Drawing;

using Rhino;
using Rhino.Geometry;

using Grasshopper;
using Grasshopper.Kernel;
using Grasshopper.Kernel.Data;
using Grasshopper.Kernel.Types;
#endregion

public class Script_Instance : GH_ScriptInstance
{
    #region Notes
    /* 
      Members:
        RhinoDoc RhinoDocument
        GH_Document GrasshopperDocument
        IGH_Component Component
        int Iteration

      Methods (Virtual & overridable):
        Print(string text)
        Print(string format, params object[] args)
        Reflect(object obj)
        Reflect(object obj, string method_name)
    */
    #endregion

    private void RunScript(double radius1, double radius2, int count, ref object a)
    {
        // Write your logic here

        double step = (2 * Math.PI) / count;
        List<Point2d> points = new List<Point2d>();

        for(double i = 0; i<2 * Math.PI; i += step)
        {
            double x = (Math.Cos(i) * radius1);
            double y = (Math.Sin(i) * radius2);

            Point2d point  = new Point2d(x,y);
            points.Add(point);
        } 
        a = points;
    }
}
# ---------- end c_script_2 ----------
pt_5 = Point(c_script_2.a)
nurbs = NurbsCurve(Vertices=pt_5, Degree=Slider(3, range=0..3), Periodic=Toggle(True))  # -> Curve, Length, Domain
crv = Curve(nurbs.Curve)

# ----
# ELLIPSE CROSSED WITH A DIAMOND
number_slider_6 = Slider(15, range=0..30)
c_script_3 = CSharpScript(radius1=number_slider_6, radius2=Slider(9, range=0..30), count=Slider(31, range=0..100))  # -> out, a; inputs radius1: Double, radius2: Double, count: Int32
# ---------- c_script_3: C# ----------
// Grasshopper Script Instance
#region Usings
using System;
using System.Linq;
using System.Collections;
using System.Collections.Generic;
using System.Drawing;

using Rhino;
using Rhino.Geometry;

using Grasshopper;
using Grasshopper.Kernel;
using Grasshopper.Kernel.Data;
using Grasshopper.Kernel.Types;
#endregion

public class Script_Instance : GH_ScriptInstance
{
    #region Notes
    /* 
      Members:
        RhinoDoc RhinoDocument
        GH_Document GrasshopperDocument
        IGH_Component Component
        int Iteration

      Methods (Virtual & overridable):
        Print(string text)
        Print(string format, params object[] args)
        Reflect(object obj)
        Reflect(object obj, string method_name)
    */
    #endregion

    private void RunScript(double radius1, double radius2, int count, ref object a)
    {
        // Write your logic here

        double step = (2 * Math.PI) / count;
        List<Point2d> points = new List<Point2d>();

        for(double i = 0; i<2 * Math.PI; i += step)
        {
            double x = Math.Cos(i) * radius1;
            double y = Math.Abs(Math.Sin(i)) * 0.5 * Math.Sin(i) * radius2;

            Point2d point  = new Point2d(x,y);
            points.Add(point);
        } 
        a = points;
    }
}
# ---------- end c_script_3 ----------
pt_6 = Point(c_script_3.a)
nurbs_2 = NurbsCurve(Vertices=pt_6, Degree=Slider(3, range=0..3), Periodic=Toggle(True))  # -> Curve, Length, Domain
crv_2 = Curve(nurbs_2.Curve)

# ----
# ELLIPSE CROSSED WITH A HYPOCYCLOID
number_slider_7 = Slider(16, range=0..30)
c_script_4 = CSharpScript(radius1=number_slider_7, radius2=Slider(2, range=0..30), count=Slider(31, range=0..100))  # -> out, a; inputs radius1: Double, radius2: Double, count: Int32
# ---------- c_script_4: C# ----------
// Grasshopper Script Instance
#region Usings
using System;
using System.Linq;
using System.Collections;
using System.Collections.Generic;
using System.Drawing;

using Rhino;
using Rhino.Geometry;

using Grasshopper;
using Grasshopper.Kernel;
using Grasshopper.Kernel.Data;
using Grasshopper.Kernel.Types;
#endregion

public class Script_Instance : GH_ScriptInstance
{
    #region Notes
    /* 
      Members:
        RhinoDoc RhinoDocument
        GH_Document GrasshopperDocument
        IGH_Component Component
        int Iteration

      Methods (Virtual & overridable):
        Print(string text)
        Print(string format, params object[] args)
        Reflect(object obj)
        Reflect(object obj, string method_name)
    */
    #endregion

    private void RunScript(double radius1, double radius2, int count, ref object a)
    {
        // Write your logic here

        double step = (2 * Math.PI) / count;
        List<Point2d> points = new List<Point2d>();

        for(double i = 0; i<2 * Math.PI; i += step)
        {
            int num_cusps = 5;
            double x = Math.Cos(i) * radius1;
            double y = (((num_cusps-1)*Math.Sin(i)) + Math.Sin((num_cusps-1)*i)) * radius2;

            Point2d point  = new Point2d(x,y);
            points.Add(point);
        } 
        a = points;
    }
}
# ---------- end c_script_4 ----------
pt_7 = Point(c_script_4.a)
nurbs_3 = NurbsCurve(Vertices=pt_7, Degree=Slider(3, range=0..3), Periodic=Toggle(True))  # -> Curve, Length, Domain
crv_3 = Curve(nurbs_3.Curve)

preview = CustomPreview(Geometry=crv, Material=ColourSwatch(SwatchColor=RGB(0, 204, 255)))
preview_2 = CustomPreview(Geometry=crv_2, Material=ColourSwatch(SwatchColor=RGB(229, 255, 0)))
preview_3 = CustomPreview(Geometry=crv_3, Material=ColourSwatch(SwatchColor=RGB(166, 0, 255)))
c_script_5 = CSharpScript(pts=pt_4, attr_pt=pt_3, power=number_slider_3, max_dist_pct=number_slider_4)  # -> out, a, b, c; inputs pts: list of Point3d, attr_pt: Point3d, power: Double, max_dist_pct: Double
# ---------- c_script_5: C# ----------
// Grasshopper Script Instance
#region Usings
using System;
using System.Linq;
using System.Collections;
using System.Collections.Generic;
using System.Drawing;

using Rhino;
using Rhino.Geometry;

using Grasshopper;
using Grasshopper.Kernel;
using Grasshopper.Kernel.Data;
using Grasshopper.Kernel.Types;
#endregion

public class Script_Instance : GH_ScriptInstance
{
    #region Notes
    /* 
      Members:
        RhinoDoc RhinoDocument
        GH_Document GrasshopperDocument
        IGH_Component Component
        int Iteration

      Methods (Virtual & overridable):
        Print(string text)
        Print(string format, params object[] args)
        Reflect(object obj)
        Reflect(object obj, string method_name)
    */
    #endregion

    private void RunScript(
		List<Point3d> pts,
		Point3d attr_pt,
		double power,
		double max_dist_pct,
		ref object a,
		ref object b,
		ref object c)
    {
        // Write your logic here
        //Attractor script

        List<Point3d> new_pts = new List<Point3d>();
        List<double> distances = new List<double>();
        List<Vector3d> vectors = new List<Vector3d>();

        // First pass: collect all distances to find the max
        double maxPossibleDistance = double.MinValue;
        foreach(Point3d gridpoint in pts)
        {
            Vector3d vector = attr_pt - gridpoint;
            double distance = vector.Length;
            distances.Add(distance);
            vectors.Add(vector);
            if(distance > maxPossibleDistance)
                maxPossibleDistance = distance;
        }

        // Second pass: apply normalized falloff
        for(int i = 0; i < pts.Count; i++)
        {
            double distance = distances[i];
            Vector3d vector = vectors[i];

            // Guard against zero distance
            if(distance < 0.0001)
            {
                new_pts.Add(pts[i]);
                continue;
            }

            double maxDistance = distance * max_dist_pct;

            double normalizedDist = distance / maxPossibleDistance;       // remap to [0,1]
            double falloff = 1 - Math.Pow(normalizedDist, power);             // power curve on [0,1]
            double actualDistance = falloff * maxPossibleDistance;        // scale back to world space

            double dist = Math.Min(maxDistance, actualDistance);

            vector.Unitize();
            Point3d pt = pts[i] + (vector * dist);
            new_pts.Add(pt);
        }

        a = new_pts;
        b = distances;
        c = vectors;
    }
}
# ---------- end c_script_5 ----------
pt_8 = Point(c_script_5.a)
